# Grasshopper definition assignment-01.gh (Grasshopper 1.0.8)

# Setting path for Src AutoReloader: 1. Right click on Path
# 2. Choose "Select a directory"
# 3. Locate the ..\cdf1_teaching\src folder in your computer
# Assignment-01: Bauhaus
number_slider = Slider(7, range=0..10)
create_cylinder = Python3Script(height=Slider(7, range=0..10), radius=Slider(4, range=0..10))  # -> out, my_cylinder; inputs base_point: Point3d, height: Double, radius: Double
# ---------- create_cylinder: Python ----------
from cdf import create_cylinder

my_cylinder = create_cylinder(base_point=base_point, height=height, radius=radius)
# ---------- end create_cylinder ----------

# ---- group: trying different things
number_slider_2 = Slider(5.6, range=1..20)
random_grid_points = Python3Script(
    seed=Slider(74, range=0..100),
    nx=Slider(5, range=0..12),
    ny=Slider(7, range=0..12),
    nz=Slider(12, range=0..12),
    cell=number_slider_2,
    count=Slider(19, range=0..100))  # -> out, points; inputs seed: Int32, nx: Int32, ny: Int32, nz: Int32, cell: Double, count: Int32
# ---------- random_grid_points: Python ----------
from cdf import random_grid_points

points = random_grid_points(seed=seed, nx=nx, ny=ny, nz=nz, cell=cell, count=count)
# ---------- end random_grid_points ----------

boxes_at_points = Python3Script(seed=Slider(57, range=0..100), max_span=Slider(4, range=1..5), slab_share=Slider(0.1, range=0..2))  # -> out, boxes; inputs points: list of Point3d, seed: Int32, cell: Double, max_span: Int32, slab_share: Double
# ---------- boxes_at_points: Python ----------
from cdf import boxes_at_points

boxes = boxes_at_points(points=points, seed=seed, cell=cell, max_span=max_span, slab_share=slab_share)
# ---------- end boxes_at_points ----------

create_element_sizes = Python3Script(
    plate_span=Slider(2, range=0..6),
    bar_span=Slider(10, range=0..10),
    disc_span=Slider(3, range=0..6),
    ring_span=Slider(6, range=0..6),
    ball_size=Slider(1, range=0..1))  # -> out, sizes; inputs plate_span: Int32, bar_span: Int32, disc_span: Int32, ring_span: Int32, ball_size: Double
# ---------- create_element_sizes: Python ----------
from cdf import create_element_sizes

sizes = create_element_sizes(plate_span=plate_span, bar_span=bar_span, disc_span=disc_span, ring_span=ring_span, ball_size=ball_size)
# ---------- end create_element_sizes ----------

scale = Python3Script(scale_x=Slider(2, range=0..10), scale_y=Slider(1, range=0..10), scale_z=Slider(2, range=0..10))  # -> out, scaled; inputs brep: Brep, center: Point3d, scale_x: Double, scale_y: Double, scale_z: Double
# ---------- scale: Python ----------
from cdf import scale_brep

scaled = scale_brep(brep=brep, center=center, scale_x=scale_x, scale_y=scale_y, scale_z=scale_z)
# ---------- end scale ----------

# ----
create_box = Python3Script(size_x=number_slider, size_y=Slider(8, range=0..10), size_z=Slider(6, range=0..10))  # -> out, my_box; inputs corner: Point3d, size_x: Double, size_y: Double, size_z: Double
# ---------- create_box: Python ----------
from cdf import create_box

my_box = create_box(corner=corner, size_x=size_x, size_y=size_y, size_z=size_z)
# ---------- end create_box ----------

# ---- group: trying different things
move_brep = Python3Script(dx=Slider(20, range=0..100), dy=Slider(0, range=0..100), dz=Slider(27, range=0..100))  # -> out, moved; inputs brep: Brep, dx: Double, dy: Double, dz: Double
# ---------- move_brep: Python ----------
from cdf import move_brep

moved = move_brep(brep=brep, dx=dx, dy=dy, dz=dz)
# ---------- end move_brep ----------

# ---- group: Auto-reloads cdf module on VScode changes
path = FilePath("/Volumes/T7_work01/_uni/m_III/_CDF01/workspace/cdf1_teaching/src/")
autoreloader = Python3Script(src_path=path)  # -> out; inputs src_path: String
# ---------- autoreloader: Python ----------
#! python3
import sys, os, time
import scriptcontext as sc
import Rhino, System
from System.IO import FileSystemWatcher, NotifyFilters

VERSION = 1  
pkg = "cdf"

if not src_path:
    raise Exception("Connect a folder to src_path.")
path = os.path.normpath(src_path)
watch_dir = os.path.join(path, pkg)
if not os.path.isdir(watch_dir):
    raise Exception("No '{}' folder found in:\n{}".format(pkg, path))

def unload():
    for name in list(sys.modules):
        if name == pkg or name.startswith(pkg + "."):
            del sys.modules[name]

# Put this folder first in Python's search list
if path in sys.path:
    sys.path.remove(path)
sys.path.insert(0, path)

key = "cdf_watcher_" + str(ghenv.Component.InstanceGuid)
time_key = key + "_time"
version_key = key + "_version"

def stamp():
    sc.sticky[time_key] = time.strftime("%Y-%m-%d %H:%M:%S")

# Replace the old watcher if the folder changed or the script was updated
old = sc.sticky.get(key)
if old is not None and (os.path.normpath(old.Path) != watch_dir
                        or sc.sticky.get(version_key) != VERSION):
    old.Dispose()
    del sc.sticky[key]
    unload()

if key not in sc.sticky:
    comp = ghenv.Component
    last = [0.0]

    def reload_and_rerun():
        unload()
        stamp()
        doc = comp.OnPingDocument()
        if doc is None:            # reloader was deleted or the file closed
            return
        for obj in doc.Objects:
            if "Python" in obj.GetType().Name:
                obj.ExpireSolution(False)   # mark as out of date
        doc.NewSolution(False)              # recompute once

    def on_change(sender, e):
        if not e.FullPath.endswith(".py") or "__pycache__" in e.FullPath:
            return
        if time.time() - last[0] < 0.5:     # ignore the second event of a double save
            return
        last[0] = time.time()
        Rhino.RhinoApp.InvokeOnUiThread(System.Action(reload_and_rerun))

    w = FileSystemWatcher(watch_dir, "*.py")
    w.IncludeSubdirectories = True
    w.NotifyFilter = NotifyFilters.LastWrite
    w.Changed += on_change
    w.EnableRaisingEvents = True
    sc.sticky[key] = w
    sc.sticky[version_key] = VERSION
    stamp()                                  # time the watcher started

msg = "Last reloaded: {}\nWatching: {}".format(sc.sticky.get(time_key, "unknown"), watch_dir)
print(msg)
out = msg
# ---------- end autoreloader ----------
panel = Panel(autoreloader)

# ---- group: color_paramters
number_slider_3 = Slider(0.3, range=0..1)
# only color seed
number_slider_4 = Slider(13, range=0..100)

# ---- group: shape_geometry_parameters
number_slider_5 = Slider(0.8, range=0..1)
number_slider_6 = Slider(1, range=0..1)
number_slider_7 = Slider(2, range=0..6)
number_slider_8 = Slider(8, range=2..8)
number_slider_9 = Slider(3, range=0..6)
number_slider_10 = Slider(2, range=0..6)
number_slider_11 = Slider(0.3, range=0..1)

# ---- group: overall_proportion_parameters
number_slider_12 = Slider(18.4, range=0..30)
number_slider_13 = Slider(26.4, range=0..60)
# probability in which axis the
# elements connect; layering
# 0=flat 1.0=more depth
# unit size
number_slider_14 = Slider(0.23, range=0..1)
number_slider_15 = Slider(17.2, range=0..30)
number_slider_16 = Slider(1.5, range=1..20)

# ---- group: composition_parameters
# random parent shape >
# random side, offset >
# check for overlap, count contacts >
# when max tries is reached: skip shape
number_slider_17 = Slider(2000, range=50..5000)
number_slider_18 = Slider(80, range=0..100)
number_slider_19 = Slider(1, range=1..4)

# ---- group: shape_parameters
number_slider_20 = Slider(0.8, range=0..1)
number_slider_21 = Slider(0.05, range=0..1)
number_slider_22 = Slider(0.03, range=0..1)
number_slider_23 = Slider(0, range=0..1)
number_slider_24 = Slider(60, range=1..60)

# ---- group: trying different things / creating primitives on point cloud
elements_at_points = Python3Script(
    points=random_grid_points.points,
    seed=Slider(66, range=0..100),
    cell=number_slider_2,
    sizes=create_element_sizes.sizes,
    bar_share=Slider(0.29, range=0..1),
    disc_share=Slider(0.04, range=0..1),
    ring_share=Slider(0.27, range=0..1),
    ball_share=Slider(0.09, range=0..1))  # -> out, elements, kinds; inputs points: list of Point3d, seed: Int32, cell: Double, sizes: list, bar_share: Double, disc_share: Double, ring_share: Double, ball_share: Double
# ---------- elements_at_points: Python ----------
from cdf import elements_at_points

elements, kinds = elements_at_points(points=points, seed=seed, cell=cell, sizes=sizes, bar_share=bar_share, disc_share=disc_share, ring_share=ring_share, ball_share=ball_share)
# ---------- end elements_at_points ----------

# ---- group: trying different things
rotate_brep = Python3Script(axis=Slider(2, range=0..2), angle_degrees=Slider(0, range=0..360))  # -> out, rotated; inputs brep: Brep, center: Point3d, axis: Int32, angle_degrees: Double
# ---------- rotate_brep: Python ----------
from cdf import rotate_brep

rotated = rotate_brep(brep=brep, center=center, axis=axis, angle_degrees=angle_degrees)
# ---------- end rotate_brep ----------

create_tube = Python3Script(height=Slider(41, range=0..100), outer_radius=Slider(8, range=0..10), inner_radius=Slider(6, range=0..10))  # -> out, my_tube; inputs base_point: Point3d, height: Double, outer_radius: Double, inner_radius: Double
# ---------- create_tube: Python ----------
from cdf import create_tube

my_tube = create_tube(base_point=base_point, height=height, outer_radius=outer_radius, inner_radius=inner_radius)
# ---------- end create_tube ----------

# ----
create_element_sizes_2 = Python3Script(
    plate_span=number_slider_7,
    bar_span=number_slider_8,
    disc_span=number_slider_9,
    ring_span=number_slider_10,
    ball_size=number_slider_11,
    slenderness=number_slider_6,
    stick_share=number_slider_5)  # -> out, sizes; inputs plate_span: Int32, bar_span: Int32, disc_span: Int32, ring_span: Int32, ball_size: Double, slenderness: Double, stick_share: Double
# ---------- create_element_sizes_2: Python ----------
from cdf import create_element_sizes

sizes = create_element_sizes(plate_span=plate_span, bar_span=bar_span, disc_span=disc_span, ring_span=ring_span, ball_size=ball_size, slenderness=slenderness, stick_share=stick_share)
# ---------- end create_element_sizes_2 ----------

# ---- group: decides what each element becomes and how many to what share
random_kinds = Python3Script(
    seed=number_slider_18,
    count=number_slider_24,
    bar_share=number_slider_20,
    disc_share=number_slider_21,
    ring_share=number_slider_22,
    ball_share=number_slider_23)  # -> out, kinds; inputs seed: Int32, count: Int32, bar_share: Double, disc_share: Double, ring_share: Double, ball_share: Double
# ---------- random_kinds: Python ----------
from cdf import random_kinds

kinds = random_kinds(seed=seed, count=count, bar_share=bar_share, disc_share=disc_share, ring_share=ring_share, ball_share=ball_share)
# ---------- end random_kinds ----------

# ---- group: builds the diff kinds of breps in diff sizes
make_elements = Python3Script(kinds=random_kinds.kinds, seed=number_slider_18, module=number_slider_16, sizes=create_element_sizes_2.sizes)  # -> out, elements; inputs kinds: list of String, seed: Int32, module: Double, sizes: list
# ---------- make_elements: Python ----------
from cdf import make_elements

elements = make_elements(kinds=kinds, seed=seed, module=module, sizes=sizes)
# ---------- end make_elements ----------

# ---- group: trying different things / creating primitives on point cloud
panel_2 = Panel(elements_at_points.kinds)

# ---- group: trying different things
# hmmm doesnt account for overlapping of forms and they are all free floating, they dont connect :(
random_kinds_2 = Python3Script()  # -> out, kinds; inputs seed: Int32, count: Int32, bar_share: Double, disc_share: Double, ring_share: Double, ball_share: Double; same code as random_kinds
make_elements_2 = Python3Script()  # -> out, elements; inputs kinds: list of String, seed: Int32, cell: Double, sizes: list
# ---------- make_elements_2: Python ----------
from cdf import make_elements

elements = make_elements(kinds=kinds, seed=seed, cell=cell, sizes=sizes)
# ---------- end make_elements_2 ----------
assemble_touching = Python3Script()  # -> out, placed, placed_kinds; inputs elements: list of Brep, kinds: list of String, seed: Int32, front_back_share: Double
# ---------- assemble_touching: Python ----------
from cdf import assemble_touching

placed, placed_kinds = assemble_touching(elements=elements, kinds=kinds, seed=seed, front_back_share=front_back_share)
# ---------- end assemble_touching ----------
earth_colors = Python3Script()  # -> out, colors; inputs kinds: list of String, seed: Int32, accent_share: Double
# ---------- earth_colors: Python ----------
from cdf import earth_colors

colors = earth_colors(kinds=kinds, seed=seed, accent_share=accent_share)
# ---------- end earth_colors ----------

# ---- group: rule base construction of geometries
assemble_touching_2 = Python3Script(
    frame_width=number_slider_12,
    frame_depth=number_slider_15,
    frame_height=number_slider_13,
    elements=make_elements.elements,
    kinds=random_kinds.kinds,
    seed=number_slider_18,
    front_back_share=number_slider_14,
    min_contacts=number_slider_19,
    max_tries=number_slider_17)  # -> out, placed, placed_kinds; inputs frame_width: Double, frame_depth: Double, frame_height: Double, elements: list of Brep, kinds: list of String, seed: Int32, front_back_share: Double, min_contacts: Int32, max_tries: Int32
# ---------- assemble_touching_2: Python ----------
from cdf import assemble_touching

placed, placed_kinds = assemble_touching(elements=elements, kinds=kinds, seed=seed, front_back_share=front_back_share, frame_width=frame_width, frame_depth=frame_depth, frame_height=frame_height, min_contacts=min_contacts, max_tries=max_tries)
# ---------- end assemble_touching_2 ----------

# ---- group: apply color
earth_colors_2 = Python3Script(kinds=assemble_touching_2.placed_kinds, seed=number_slider_4, accent_share=number_slider_3)  # -> out, colors; inputs kinds: list of String, seed: Int32, accent_share: Double; same code as earth_colors

# ----
panel_3 = Panel(assemble_touching_2.placed_kinds)

material = CreateMaterial(Diffuse=earth_colors_2.colors, Specular=RGB(255, 254, 255), Emission=RGB(0, 0, 0), Transparency=0, Shine=0)
preview = CustomPreview(Geometry=assemble_touching_2.placed, Material=material)
